# Grasshopper definition absolute_easy.ghx (Grasshopper 1.0.7)

panel = Panel("""def absolute_easy(x):
    \"\"\"
    Addition (easy)
    
    Args:
        x (float): Input value
    
    Retruns:
        Absolute value of x
    \"\"\"
    
    # your code here
    
    return None

a = absolute_easy(x)""")
path = FilePath("path-to-grasshopper-component-challenges-package")
absolute_easy = Absolute_easy(pkg_path=path, code=panel)  # -> result, gh_output, code_output
panel_2 = Panel(absolute_easy.result)

# ==== cluster Absolute_easy
pkg_path = ClusterInput()
code = ClusterInput()
testcases = GhPythonScript(pkg_path=pkg_path)  # -> a
# ---------- testcases: Python ----------
import sys
sys.path.append(pkg_path)

from grasshopper_challenges.testcases import absolute_easy

a = absolute_easy.tc
# ---------- end testcases ----------
abs = Absolute(Value=testcases)
python = GhPythonScript(Code=code, X=testcases)
judge = GhPythonScript(pkg_path=pkg_path, x=abs, y=python)  # -> out, a
# ---------- judge: Python ----------
import sys
sys.path.append(pkg_path)

from grasshopper_challenges.judges import absolute_easy

a = absolute_easy.judge(x, y)
# ---------- end judge ----------
result = ClusterOutput(judge.a)
gh_output = ClusterOutput(abs)
code_output = ClusterOutput(python)
