# Grasshopper definition addition_easy.ghx (Grasshopper 1.0.7)

panel = Panel("""def addition_easy(x, y):
    \"\"\"
    Addition (easy)
    
    Args:
        x (float): First intput value
        y (float): Second input value
    
    Retruns:
        Sum of x and y
    \"\"\"
    
    # your code here
    
    return None

a = addition_easy(x, y)""")
path = FilePath("path-to-grasshopper-component-challenges-package")
addition_easy = Addition_easy(pkg_path=path, code=panel)  # -> result, gh_output, code_output
panel_2 = Panel(addition_easy.result)

# ==== cluster Addition_easy
pkg_path = ClusterInput()
code = ClusterInput()
testcases = GhPythonScript(pkg_path=pkg_path)  # -> a, b
# ---------- testcases: Python ----------
import sys
sys.path.append(pkg_path)

from grasshopper_challenges.testcases import addition_easy

a = addition_easy.tc_a
b = addition_easy.tc_b
# ---------- end testcases ----------
python = GhPythonScript(Code=code, X=testcases.a, Y=testcases.b)
addition = Addition(A=testcases.a, B=testcases.b)
judge = GhPythonScript(pkg_path=pkg_path, x=addition, y=python)  # -> out, a
# ---------- judge: Python ----------
import sys
sys.path.append(pkg_path)

from grasshopper_challenges.judges import addition_easy

a = addition_easy.judge(x, y)
# ---------- end judge ----------
result = ClusterOutput(judge.a)
gh_output = ClusterOutput(addition)
code_output = ClusterOutput(python)
