# Grasshopper definition bounds_easy.ghx (Grasshopper 1.0.7)

panel = Panel("""def bounds_easy(l):
    \"\"\"
    Bounds (easy)
    
    Args:
        l (List[float]): List of numbers
    
    Retruns:
        (Interval)
        Numeric domain defined with minimum and maximum values in the input list.
    \"\"\"
    
    # your code here

    return None

a = bounds_easy(x)""")
path = FilePath("path-to-grasshopper-component-challenges-package")
bounds_easy = Bounds_easy(pkg_path=path, code=panel)  # -> result, gh_output, code_output
panel_2 = Panel(bounds_easy.result)

# ==== cluster Bounds_easy
pkg_path = ClusterInput()
code = ClusterInput()
testcases = GhPythonScript(pkg_path=pkg_path)  # -> a_tree, a
# ---------- testcases: Python ----------
import sys
sys.path.append(pkg_path)

from ghpythonlib import treehelpers
from grasshopper_challenges.testcases import bounds_easy

a = bounds_easy.tc
a_tree = treehelpers.list_to_tree(a)
# ---------- end testcases ----------
bnd = Bounds(Numbers=testcases.a_tree)
python = GhPythonScript(Code=code, X=testcases.a)  # -> graft(A)
judge = GhPythonScript(pkg_path=pkg_path, x=bnd, y=python)  # -> out, a
# ---------- judge: Python ----------
import sys
sys.path.append(pkg_path)

from grasshopper_challenges.judges import bounds_easy

print(type(y))
a = bounds_easy.judge(x, y)
# ---------- end judge ----------
result = ClusterOutput(judge.a)
gh_output = ClusterOutput(bnd)
code_output = ClusterOutput(python)
