# Grasshopper definition box_2pt_easy.ghx (Grasshopper 1.0.7)

panel = Panel("""def box_2pt_easy(x, y):
    \"\"\"
    Box 2Pt (Easy)
    
    Args:
        x (Point3D): First corner.
        y (Point3D): Second corner.
    
    Retruns:
        (Box)
        Box with corner x, y, created in World XY.
    \"\"\"
    # your code here

    return None

a = box_2pt_easy(x, y)""")
path = FilePath("path-to-grasshopper-component-challenges-package")
box_2pt_easy = Box_2pt_easy(pkg_path=path, code=panel)  # -> result, gh_output, code_output
panel_2 = Panel(box_2pt_easy.result)

# ==== cluster Box_2pt_easy
pkg_path = ClusterInput()
code = ClusterInput()
testcases = GhPythonScript(pkg_path=pkg_path)  # -> a, b
# ---------- testcases: Python ----------
import sys
sys.path.append(pkg_path)

from grasshopper_challenges.testcases import box_2pt_easy

a = box_2pt_easy.tc_a
b = box_2pt_easy.tc_b
# ---------- end testcases ----------
python = GhPythonScript(Code=code, X=testcases.a, Y=testcases.b)
box = Box2Pt(PointA=testcases.a, PointB=testcases.b, Plane=PlaneXY(0, 0, 0))
judge = GhPythonScript(pkg_path=pkg_path, x=box, y=python)  # -> out, a
# ---------- judge: Python ----------
import sys
sys.path.append(pkg_path)

from grasshopper_challenges.judges import box_2pt_easy

a = box_2pt_easy.judge(x, y)
# ---------- end judge ----------
result = ClusterOutput(judge.a)
gh_output = ClusterOutput(box)
code_output = ClusterOutput(python)
