# Grasshopper definition convex_hull_easy.ghx (Grasshopper 1.0.7)

panel = Panel("""def convex_hull_easy(x):
    \"\"\"
    Convex Hull (Easy)
    
    Args:
        x (List[Point3d]): List of points to create convex hull.
    
    Retruns:
        (Tuple[Polyline, Polyline, List[int]])
        - Convex hull in base plane space.
        - Convex hull in world space.
        - List of indices of points in convex hull `H`.
        
    \"\"\"
    # your code here
    
    return None, None, None

a, b, c = convex_hull_easy(x)""")
path = FilePath("path-to-grasshopper-component-challenges-package")
convex_hull_easy = Convex_hull_easy(pkg_path=path, code=panel)  # -> result, result_2, result_3, gh_output, gh_output_3, gh_output_2, code_output, code_output_2, code_output_3
panel_2 = Panel(convex_hull_easy.result)
panel_3 = Panel(convex_hull_easy.result_2)
panel_4 = Panel(convex_hull_easy.result_3)

# ==== cluster Convex_hull_easy
pkg_path = ClusterInput()
code = ClusterInput()
testcases = GhPythonScript(pkg_path=pkg_path)  # -> a
# ---------- testcases: Python ----------
import sys
sys.path.append(pkg_path)

from ghpythonlib import treehelpers
from grasshopper_challenges.testcases import convex_hull_easy

a = treehelpers.list_to_tree(convex_hull_easy.tc_p)
# ---------- end testcases ----------
hull = ConvexHull(Points=testcases, Plane=PlaneXY(0, 0, 0))  # -> Hull, HullZ, Indices
python = GhPythonScript(Code=code, X=testcases)  # -> A, B, C
judge = GhPythonScript(pkg_path=pkg_path, x=hull.Hull, y=hull.HullZ, z=hull.Indices, u=python.A, v=python.B, w=python.C)  # -> out, a, b, c; inputs x: Polyline, y: Polyline, z: list, u: Polyline, v: Polyline, w: list
# ---------- judge: Python ----------
import sys
sys.path.append(pkg_path)

from grasshopper_challenges.judges import convex_hull_easy

# WIP

a = x==u
b = y==v
c = z==w
# ---------- end judge ----------
gh_output = ClusterOutput(hull.Hull)
gh_output_2 = ClusterOutput(hull.Indices)
result = ClusterOutput(judge.a)
gh_output_3 = ClusterOutput(hull.HullZ)
result_2 = ClusterOutput(judge.b)
code_output = ClusterOutput(python.A)
result_3 = ClusterOutput(judge.c)
code_output_2 = ClusterOutput(python.B)
code_output_3 = ClusterOutput(python.C)
