# Grasshopper definition cull_nth_standard.ghx (Grasshopper 1.0.7)

panel = Panel("""def cull_nth_standard(x, y):
    \"\"\"
    Cull nth (Standard)
    
    Args:
        x (List[Any]): List to cull.
        y (int): Cull yth.
    
    Retruns:
        (List[Any])
        Culled list.
        
    \"\"\"
    # your code here

    return None

a = cull_nth_standard(x, y)""")
path = FilePath("path-to-grasshopper-component-challenges-package")
cull_nth_standard = Cull_nth_standard(pkg_path=path, code=panel)  # -> result, gh_output, code_output
panel_2 = Panel(cull_nth_standard.result)

# ==== cluster Cull_nth_standard
pkg_path = ClusterInput()
code = ClusterInput()
testcases = GhPythonScript(pkg_path=pkg_path)  # -> simplify(a), graft(b)
# ---------- testcases: Python ----------
import sys
sys.path.append(pkg_path)

from ghpythonlib import treehelpers
from grasshopper_challenges.testcases import cull_nth_standard

a = treehelpers.list_to_tree(cull_nth_standard.tc_l)
b = cull_nth_standard.tc_n
# ---------- end testcases ----------
python = GhPythonScript(Code=code, X=testcases.a, Y=testcases.b)  # -> simplify(A)
culln = CullNth(List=testcases.a, CullFrequency=testcases.b)  # -> simplify(List)
judge = GhPythonScript(pkg_path=pkg_path, x=culln, y=python)  # -> out, a; inputs x: list, y: list
# ---------- judge: Python ----------
import sys
sys.path.append(pkg_path)

from grasshopper_challenges.judges import cull_nth_standard

a = cull_nth_standard.judge(x, y)
# ---------- end judge ----------
code_output = ClusterOutput(python)
gh_output = ClusterOutput(culln)
result = ClusterOutput(judge.a)
