# Grasshopper definition delete_consecutive_standard.ghx (Grasshopper 1.0.7)

panel = Panel("""def delete_consecutive_standard(x, y):
    \"\"\"
    Delete Consecutive (Standard)
    
    Args:
        x (List[Any]): List to process.
        y (bool): Wrap list.
    
    Retruns:
        (List[Any], int)
        - New list with consecutive same items removed.
        - Number of removed Items.
        
    \"\"\"
    # your code here

    return None, None

a, b = delete_consecutive_standard(x, y)""")
path = FilePath("path-to-grasshopper-component-challenges-package")
delete_consecutive_standard = Delete_consecutive_standard(pkg_path=path, code=panel)  # -> result, result_2, gh_output, gh_output_2, code_output, code_output_2
panel_2 = Panel(delete_consecutive_standard.result_2)
panel_3 = Panel(delete_consecutive_standard.result)

# ==== cluster Delete_consecutive_standard
pkg_path = ClusterInput()
code = ClusterInput()
testcases = GhPythonScript(pkg_path=pkg_path)  # -> simplify(a), graft(b)
# ---------- testcases: Python ----------
import sys
sys.path.append(pkg_path)

from ghpythonlib import treehelpers
from grasshopper_challenges.testcases import delete_consecutive_standard

a = treehelpers.list_to_tree(delete_consecutive_standard.tc_s)
b = delete_consecutive_standard.tc_w
# ---------- end testcases ----------
python = GhPythonScript(Code=code, X=testcases.a, Y=testcases.b)  # -> simplify(A), B
dcon = DeleteConsecutive(Set=testcases.a, Wrap=testcases.b)  # -> Set, Count
judge = GhPythonScript(pkg_path=pkg_path, x=dcon.Set, y=dcon.Count, z=python.A, u=python.B)  # -> out, a, b; inputs x: list, z: list
# ---------- judge: Python ----------
import sys
sys.path.append(pkg_path)

from grasshopper_challenges.judges import delete_consecutive_standard

print(x,z)
a = delete_consecutive_standard.judge_s(x, z)
b = delete_consecutive_standard.judge_n(y, u)
# ---------- end judge ----------
code_output = ClusterOutput(python.A)
code_output_2 = ClusterOutput(python.B)
gh_output = ClusterOutput(dcon.Set)
gh_output_2 = ClusterOutput(dcon.Count)
result = ClusterOutput(judge.a)
result_2 = ClusterOutput(judge.b)
