# Grasshopper definition dist_standard.ghx (Grasshopper 1.0.7)

panel = Panel("""def distance_standard(x, y):
    \"\"\"
    Distance (standard)
    
    Args:
        x (Point3D): First point
        y (Point3D): Second point
    
    Retruns:
        Distance between two input points (number)
    \"\"\"
    # your code here

    return None

a = distance_standard(x, y)""")
path = FilePath("path-to-grasshopper-component-challenges-package")
distance_standard = Distance_standard(pkg_path=path, code=panel)  # -> result, gh_output, code_output
panel_2 = Panel(distance_standard.result)

# ==== cluster Distance_standard
pkg_path = ClusterInput()
code = ClusterInput()
testcases = GhPythonScript(pkg_path=pkg_path)  # -> a, b
# ---------- testcases: Python ----------
import sys
sys.path.append(pkg_path)

from grasshopper_challenges.testcases import distance_standard

a = distance_standard.tc_a
b = distance_standard.tc_b
# ---------- end testcases ----------
dist = Distance(PointA=testcases.a, PointB=testcases.b)
python = GhPythonScript(Code=code, X=testcases.a, Y=testcases.b)
judge = GhPythonScript(pkg_path=pkg_path, x=dist, y=python)  # -> out, a
# ---------- judge: Python ----------
import sys
sys.path.append(pkg_path)

from grasshopper_challenges.judges import distance_standard

a = distance_standard.judge(x, y)
# ---------- end judge ----------
result = ClusterOutput(judge.a)
gh_output = ClusterOutput(dist)
code_output = ClusterOutput(python)
