# Grasshopper definition fibonacci_easy.ghx (Grasshopper 1.0.7)

panel = Panel("""def fibonacci_easy(x, y, z):
    \"\"\"
    Fibonacci (Easy)
    
    Args:
        x (float): First seed number for fibonacci sequence.
        y (float): Second seed number for fibonacci sequence.
        z (int): Number of values in the sequence.
    
    Retruns:
        (List[float])
        First N + 2 values of fibonacci sequnce generated with seed A and B. The sequence starts with [A, B].
        
    \"\"\"
    # your code here

    return None

a = fibonacci_easy(x, y, z)""")
path = FilePath("path-to-grasshopper-component-challenges-package")
fibonacci_easy = Fibonacci_easy(pkg_path=path, code=panel)  # -> result, gh_output, code_output
panel_2 = Panel(fibonacci_easy.result)

# ==== cluster Fibonacci_easy
pkg_path = ClusterInput()
code = ClusterInput()
testcases = GhPythonScript(pkg_path=pkg_path)  # -> a, b, c
# ---------- testcases: Python ----------
import sys
sys.path.append(pkg_path)

from grasshopper_challenges.testcases import fibonacci_easy

a = fibonacci_easy.tc_a
b = fibonacci_easy.tc_b
c = fibonacci_easy.tc_n
# ---------- end testcases ----------
fib = Fibonacci(SeedA=testcases.a, SeedB=testcases.b, Number=testcases.c)
python = GhPythonScript(Code=code, X=testcases.a, Y=testcases.b, Z=testcases.c)
judge = GhPythonScript(pkg_path=pkg_path, x=fib, y=python)  # -> out, a; inputs x: list, y: list
# ---------- judge: Python ----------
import sys
sys.path.append(pkg_path)

from grasshopper_challenges.judges import fibonacci_easy

a = fibonacci_easy.judge(x, y)
# ---------- end judge ----------
code_output = ClusterOutput(python)
gh_output = ClusterOutput(fib)
result = ClusterOutput(judge.a)
