# Grasshopper definition larger_than_easy.ghx (Grasshopper 1.0.7)

panel = Panel("""def larger_than_easy_gt(x, y):
    \"\"\"
    Larger Than (easy) - greater
    
    Args:
        x (float): First intput value
        y (float): Second input value
    
    Retruns:
        (boolean) x is greater than y
    \"\"\"
    
    # your code here
    
    return None

def larger_than_easy_ge(x, y):
    \"\"\"
    Larger Than (easy) - greater or equal
    
    Args:
        x (float): First intput value
        y (float): Second input value
    
    Retruns:
        (boolean) x is greater or equal to y
    \"\"\"
    
    # your code here
    
    return None

a = larger_than_easy_gt(x, y)
b = larger_than_easy_ge(x, y)""")
path = FilePath("path-to-grasshopper-component-challenges-package")
larger_than_easy = Larger_than_easy(pkg_path=path, code=panel)  # -> result, result_2, gh_output, gh_output_2, code_output, code_output_2
panel_2 = Panel(larger_than_easy.result)
panel_3 = Panel(larger_than_easy.result_2)

# ==== cluster Larger_than_easy
pkg_path = ClusterInput()
code = ClusterInput()
testcases = GhPythonScript(pkg_path=pkg_path)  # -> a, b
# ---------- testcases: Python ----------
import sys
sys.path.append(pkg_path)

from grasshopper_challenges.testcases import larger_than_easy

a = larger_than_easy.tc_a
b = larger_than_easy.tc_b
# ---------- end testcases ----------
larger = LargerThan(FirstNumber=testcases.a, SecondNumber=testcases.b)  # -> LargerThan, OrEqualTo
python = GhPythonScript(Code=code, X=testcases.a, Y=testcases.b)  # -> A, B
judge_ge = GhPythonScript(pkg_path=pkg_path, x=larger.OrEqualTo, y=python.B)  # -> out, a
# ---------- judge_ge: Python ----------
import sys
sys.path.append(pkg_path)

from grasshopper_challenges.judges import larger_than_easy

a = larger_than_easy.judge_ge(x, y)
# ---------- end judge_ge ----------
judge_gt = GhPythonScript(pkg_path=pkg_path, x=larger.LargerThan, y=python.A)  # -> out, a
# ---------- judge_gt: Python ----------
import sys
sys.path.append(pkg_path)

from grasshopper_challenges.judges import larger_than_easy

a = larger_than_easy.judge_gt(x, y)
# ---------- end judge_gt ----------
code_output = ClusterOutput(python.A)
gh_output = ClusterOutput(larger.LargerThan)
gh_output_2 = ClusterOutput(larger.OrEqualTo)
code_output_2 = ClusterOutput(python.B)
result = ClusterOutput(judge_gt.a)
result_2 = ClusterOutput(judge_ge.a)
