# Grasshopper definition mass_multiplication_easy.ghx (Grasshopper 1.0.7)

panel = Panel("""def mass_multiplication_easy(x):
    \"\"\"
    Mass Multiplication(easy)
    
    Args:
        l (List[float]): List of values
    
    Retruns:
        (Tuple(result, partial_result))
        result: All values in the input list multiplied.
        partial_result: Partial results (mass multiplication result up to nth value).
	
    \"\"\"

    # your code here
    
    return None, None

a, b = mass_multiplication_easy(x)""")
path = FilePath("path-to-grasshopper-component-challenges-package")
mass_multiplication_easy = Mass_multiplication_easy(pkg_path=path, code=panel)  # -> result, result_2, gh_output, gh_output_2, code_output, code_output_2
panel_2 = Panel(mass_multiplication_easy.result)
panel_3 = Panel(mass_multiplication_easy.result_2)

# ==== cluster Mass_multiplication_easy
pkg_path = ClusterInput()
code = ClusterInput()
testcases = GhPythonScript(pkg_path=pkg_path)  # -> a_tree, a
# ---------- testcases: Python ----------
import sys
sys.path.append(pkg_path)

from ghpythonlib import treehelpers
from grasshopper_challenges.testcases import mass_multiplication_easy

a = mass_multiplication_easy.tc
a_tree = treehelpers.list_to_tree(a)
# ---------- end testcases ----------
mm = MassMultiplication(Input=testcases.a_tree)  # -> Result, PartialResults
python = GhPythonScript(Code=code, X=testcases.a)  # -> graft(A), B
judge_pr = GhPythonScript(pkg_path=pkg_path, x=mm.PartialResults, y=python.B)  # -> out, a
# ---------- judge_pr: Python ----------
import sys
sys.path.append(pkg_path)

from grasshopper_challenges.judges import mass_multiplication_easy

a = mass_multiplication_easy.judge_pr(x, y)
# ---------- end judge_pr ----------
judge_r = GhPythonScript(pkg_path=pkg_path, x=mm.Result, y=python.A)  # -> out, a
# ---------- judge_r: Python ----------
import sys
sys.path.append(pkg_path)

from grasshopper_challenges.judges import mass_multiplication_easy

a = mass_multiplication_easy.judge_r(x, y)
# ---------- end judge_r ----------
gh_output = ClusterOutput(mm.Result)
code_output = ClusterOutput(python.A)
gh_output_2 = ClusterOutput(mm.Result)
code_output_2 = ClusterOutput(python.A)
result = ClusterOutput(judge_r.a)
result_2 = ClusterOutput(judge_pr.a)
