# Grasshopper definition pi_standard.ghx (Grasshopper 1.0.7)

panel = Panel("""def pi_standard(x):
    \"\"\"
    Pi (standard)
    
    Args:
        x (float): Input value
    
    Retruns:
        x * pi
    \"\"\"
    
    # your code here
    
    return None

a = pi_standard(x)""")
path = FilePath("path-to-grasshopper-component-challenges-package")
pi_standard = Pi_standard(pkg_path=path, code=panel)  # -> result, gh_output, code_output
panel_2 = Panel(pi_standard.result)

# ==== cluster Pi_standard
pkg_path = ClusterInput()
code = ClusterInput()
testcases = GhPythonScript(pkg_path=pkg_path)  # -> a
# ---------- testcases: Python ----------
import sys
sys.path.append(pkg_path)

from grasshopper_challenges.testcases import pi_standard

a = pi_standard.tc
# ---------- end testcases ----------
pi = Pi(Factor=testcases)
python = GhPythonScript(Code=code, X=testcases)
judge = GhPythonScript(pkg_path=pkg_path, x=pi, y=python)  # -> out, a
# ---------- judge: Python ----------
import sys
sys.path.append(pkg_path)

from grasshopper_challenges.judges import pi_standard

a = pi_standard.judge(x, y)
# ---------- end judge ----------
result = ClusterOutput(judge.a)
gh_output = ClusterOutput(pi)
code_output = ClusterOutput(python)
