# Grasshopper definition unit_vector_standard.ghx (Grasshopper 1.0.7)

panel = Panel("""def unit_vector_standard(x):
    \"\"\"
    Distance (standard)
    
    Args:
        x (Vector3d): Vector to unitize.
    
    Retruns:
        Unitzed vector if x can be unitized, else x.
    \"\"\"
    # your code here

    return None

a = unit_vector_standard(x)""")
path = FilePath("path-to-grasshopper-component-challenges-package")
unit_vector_standard = Unit_vector_standard(pkg_path=path, code=panel)  # -> result, gh_output, code_output
panel_2 = Panel(unit_vector_standard.result)

# ==== cluster Unit_vector_standard
pkg_path = ClusterInput()
code = ClusterInput()
testcases = GhPythonScript(pkg_path=pkg_path)  # -> a
# ---------- testcases: Python ----------
import sys
sys.path.append(pkg_path)

from grasshopper_challenges.testcases import unit_vector_standard

a = unit_vector_standard.tc
# ---------- end testcases ----------
python = GhPythonScript(Code=code, X=testcases)
unit = UnitVector(Vector=testcases)
judge = GhPythonScript(pkg_path=pkg_path, x=unit, y=python)  # -> out, a
# ---------- judge: Python ----------
import sys
sys.path.append(pkg_path)

from grasshopper_challenges.judges import unit_vector_standard

a = unit_vector_standard.judge(x, y)
# ---------- end judge ----------
result = ClusterOutput(judge.a)
gh_output = ClusterOutput(unit)
code_output = ClusterOutput(python)
